# Grasshopper definition 1 Math.gh (Grasshopper 1.0.7)

# ---- group: I'm also a Domain
panel = Panel("0 to 1")

# ----
panel_2 = Panel("""3
7
2
6
7
2
4""")
panel_3 = Panel("""0.0
0.1
0.2
0.3
0.4
0.5
0.6
0.7
0.8
0.9
1.0""")
panel_4 = Panel("""1
2
3
4
5
6
7
8
9
10""")
panel_5 = Panel("""1
2
3
4
5
6
7
8
9
10""")
construct_domain = ConstructDomain(DomainStart="3", DomainEnd="5.7")
bounds = Bounds(Numbers=panel_2)
number = Number(panel_4)
mass_addition = MassAddition(Input=panel_5)  # -> Result, PartialResults
pi = Pi(Factor="0.5")
addition = Addition(A="1", B="2")
subtraction = Subtraction(A="1", B="2")
multiplication = Multiplication(A="3", B="2")
division = Division(A="1", B="2")
modulus = Modulus(A="5", B="3")
larger_than = LargerThan(FirstNumber="3", SecondNumber="1")  # -> LargerThan, OrEqualTo
square_root = SquareRoot(Value="2")
power_of_e = PowerOfE(Value="5")
cube = Cube(Value="3")
cosine = Cosine(Value="1")
remap_numbers = RemapNumbers(Value=panel_3, Source="0 to 1", Target="3 to 5")  # -> Mapped, Clipped
average = Average(Input=number)
round = Round(Number=Slider(3.4, range=0..10))  # -> Nearest, Floor, Ceiling
panel_6 = Panel(bounds)
deconstruct_domain = DeconstructDomain(Domain=construct_domain)  # -> Start, End
panel_7 = Panel(construct_domain)
panel_8 = Panel(addition)
panel_9 = Panel(subtraction)
panel_10 = Panel(multiplication)
panel_11 = Panel(division)
panel_12 = Panel(modulus)
panel_13 = Panel(pi)
deconstruct_domain_2 = DeconstructDomain(Domain=bounds)  # -> Start, End
panel_14 = Panel(mass_addition.Result)
panel_15 = Panel(mass_addition.PartialResults)
panel_16 = Panel(square_root)
panel_17 = Panel(power_of_e)
panel_18 = Panel(cube)

# ---- group: cos 1
panel_19 = Panel(cosine)

# ----
gate_and = GateAnd(A=larger_than.LargerThan, B="False")
panel_20 = Panel(round.Floor)
panel_21 = Panel(round.Ceiling)
panel_22 = Panel(round.Nearest)
panel_23 = Panel(remap_numbers.Mapped)
panel_24 = Panel(larger_than.LargerThan)

# ---- group: Mean value
panel_25 = Panel(average)

# ----
panel_26 = Panel(gate_and)
panel_27 = Panel(deconstruct_domain.End)
panel_28 = Panel(deconstruct_domain.Start)

# ---- group: The maximum
panel_29 = Panel(deconstruct_domain_2.Start)

# ---- group: The minimum
panel_30 = Panel(deconstruct_domain_2.End)
