# Grasshopper definition 2_0 Set List.gh (Grasshopper 1.0.7)

panel = Panel("""a
b
c
d
e
f
g
h
i
j
k
l""")

# ---- group: Where to put every items
panel_2 = Panel("""0
1""")

# ----
panel_3 = Panel("""a
b
c
d
e""")
panel_4 = Panel("""a
b
c
d
e""")

# ---- group: Where to put every items
panel_5 = Panel("""True
False""")

# ----
panel_6 = Panel("""a
b
c
d
e
f
g
h
i
j
k
l""")
panel_7 = Panel("""a
b
c
d
e""")

# ---- group: Strength
number_slider = Slider(0.03, range=0..1)

# ---- group: There can be more than 2 outputs
sift_pattern = SiftPattern(List=panel, SiftPattern=panel_2)  # -> Output0, Output1

# ----
panel_8 = Panel("""a
b
c
d
e""")
panel_9 = Panel("""a
b
c""")
range = Range(Domain=Domain(0, 1), Steps="100")
panel_10 = Panel("""a
b
c""")
panel_11 = Panel("""a
b
c
d
e""")
series = Series(Start=0, Step="0.1", Count="100")

# ---- group: Don't use it. There may be some bug
item_index = ItemIndex(List=panel_3, Item="b")

# ----
panel_12 = Panel("""1
2
3""")
panel_13 = Panel("""a
b
c
d
e""")
list_length = ListLength(List=panel_7)
list_item = ListItem(List=panel_4, Index=Slider(1, range=0..4), Wrap=True)
dispatch = Dispatch(List=panel_6, DispatchPattern=panel_5)  # -> ListA, ListB
panel_14 = Panel("""1
3""")
panel_15 = Panel("""a
b
c
d
e""")
longest_list = LongestList(ListListA=panel_15, ListListB="True", PaddingMode=2)  # -> ListListA, ListListB
repeat_data = RepeatData(Data=panel_10, Length="6")
panel_16 = Panel("""1
2
3
5
3
1""")
stack_data = StackData(Data=panel_9, Stack="2")
panel_17 = Panel("""0
1""")
split_list = SplitList(List=panel_8, Index=Slider(2, range=0..5))  # -> ListA, ListB
shift_list = ShiftList(List=panel_11, Shift=Slider(2, range=0..5), Wrap=True)
random = Random(Range=Domain(0, 1), Number="100", Seed=2)
replace_items = ReplaceItems(List=longest_list.ListListB, Item="False", Indices=panel_14, Wrap=False)
panel_18 = Panel(longest_list.ListListB)

# ---- group: Delete Nulls
null_item = NullItem(Item=sift_pattern.Output0)  # -> NullFlags, InvalidFlags, Description
null_item_2 = NullItem(Item=sift_pattern.Output1)  # -> NullFlags, InvalidFlags, Description
cull_pattern = CullPattern(List=sift_pattern.Output0, CullPattern=invert(null_item.NullFlags))
cull_pattern_2 = CullPattern(List=sift_pattern.Output1, CullPattern=invert(null_item_2.NullFlags))

# ----
shortest_list = ShortestList(ListA=panel_13, ListB=panel_12, TrimMode=2)  # -> ListA, ListB
panel_19 = Panel(series)
panel_20 = Panel(range)

# ---- group: Randomly rearrangement the items
jitter = Jitter(List=range, Jitter=number_slider, Seed=2)  # -> Values, Indices

# ----
cull_index = CullIndex(List=panel_15, Indices=panel_14, Wrap=True)

# ---- group: Remove duplicated items
create_set = CreateSet(List=panel_16)  # -> Set, Map

# ---- group: Length of the list
panel_21 = Panel(list_length)

# ----
pick_n_choose = PickNChoose(Pattern=panel_17, Stream0=dispatch.ListA, Stream1=dispatch.ListB)
weave = Weave(Pattern=panel_17, Stream0=dispatch.ListA, Stream1=dispatch.ListB, NullGaps=False)
panel_22 = Panel(repeat_data)
panel_23 = Panel(stack_data)
cull_pattern_3 = CullPattern(List=panel_15, CullPattern=replace_items)
panel_24 = Panel(list_item)
panel_25 = Panel(dispatch.ListA)
panel_26 = Panel(dispatch.ListB)
panel_27 = Panel(split_list.ListA)
panel_28 = Panel(split_list.ListB)
panel_29 = Panel(shift_list)

# ---- group: In my version (1.0.0007), the output is -1, which is wrong
panel_30 = Panel(item_index)

# ----
panel_31 = Panel(replace_items)
panel_32 = Panel(create_set.Set)
panel_33 = Panel(random)
panel_34 = Panel(shortest_list.ListB)
panel_35 = Panel(shortest_list.ListA)
panel_36 = Panel(pick_n_choose)
panel_37 = Panel(weave)
panel_38 = Panel(jitter.Values)
panel_39 = Panel(cull_index)
panel_40 = Panel(cull_pattern_3)
quick_graph = QuickGraph(jitter.Values, SortOrder=0)
panel_41 = Panel(cull_pattern_2)
panel_42 = Panel(cull_pattern)
