# Grasshopper definition 5.0 Surface.gh (Grasshopper 1.0.7)

cylinder = Cylinder(Base="{2,0,0}", Radius=0.5, Length=1)
cone = Cone(Base="{4,0,0}", Radius=0.5, Length=1)  # -> Cone, Tip
domain_box = DomainBox(Base=PlaneXY(0, 0, 0), X="0 to 1", Y="0 to 1", Z="0 to 1")
sphere = Sphere(Base="{1,3,0}", Radius=1)
quad_sphere = QuadSphere(Base="{4,3,0}", Radius=1)
