# Grasshopper definition 5.2 Surface.gh (Grasshopper 1.0.7)

domain_box = DomainBox(Base=PlaneXY(0, 0, 0), X="-1 to 1", Y="-1 to 1", Z="-1 to 2")
cone = Cone(Base=PlaneXY(0, 0, 0), Radius=0.5, Length=1)  # -> Cone, Tip
populate_3d = Populate3D(Region=domain_box, Count="500", Seed=1)
cap_holes = CapHoles(Brep=cone.Cone)
brep_closest_point = BrepClosestPoint(Point=populate_3d, Brep=cap_holes)  # -> Point, Normal, Distance
line = Line(StartPoint=populate_3d, EndPoint=brep_closest_point.Point)
