# Grasshopper definition 6.1 Mesh.gh (Grasshopper 1.0.7)

# Let's construct a mesh from scratch.
panel = Panel("2")
pi = Pi(Factor=panel)
division = Division(A=pi, B="6")
series = Series(Start=0, Step=division, Count="6")
cosine = Cosine(Value=series)
sine = Sine(Value=series)
point = Point("{0,0,0}")
construct_point = ConstructPoint(XCoordinate=cosine, YCoordinate=sine, ZCoordinate=0)
merge = Merge(Data1=point, Data2=flatten(construct_point))
point_list = PointList(Points=merge, Size=Slider(0.36, range=0..1))
panel_2 = Panel("""0
0
0
0
0
0""")
panel_3 = Panel("""1
2
3
4
5
6""")
panel_4 = Panel("""2
3
4
5
6
1""")
mesh_triangle = MeshTriangle(CornerA=panel_2, CornerB=panel_3, CornerC=panel_4)
panel_5 = Panel(mesh_triangle)

# ---- group: The mesh
construct_mesh = ConstructMesh(Vertices=merge, Faces=mesh_triangle)
